# Dynamo graph JsonParser-Assembly3.dyn (Dynamo 1.2.0.2690)

file_path = Filename("..\..\..\..\..\Temp\-Changes-Latest.json")
fromPath = FileObject(file_path)  # "File.FromPath"
watch = Watch(fromPath)

# group: Add Text to Chart
string = StringInput("Number of Changes by Element Type")
code_block = CodeBlock { 1; 1; }
address = Charts.MiscNodes.Address(code_block.out0, code_block.out1)
style = Text.Text.Style(arg1=address)
create = Text.Text.Create(string, style)

# group: JSON Parser
readFromFile = DynamoJson.FileHelper.ReadFromFile(file_path)
toSublists = DynamoJson.JsonParser.ToSublists(readFromFile)
toDictionary = DynamoJson.JsonParser.ToDictionary(readFromFile)
getKeys = GetKeys(toDictionary)
code_block_2 = CodeBlock { "Changes"; }
indexOf = IndexOf(getKeys, code_block_2)
getItemAtIndex = List.GetItemAtIndex(list=toSublists, index=indexOf)
restOfItems = List.RestOfItems(getItemAtIndex)
code_block_3 = CodeBlock { 1; }
flatten = List.Flatten(list=restOfItems, amt=code_block_3)
transpose = List.Transpose(flatten@L3)
code_block_4 = CodeBlock { 1; }
getItemAtIndex_2 = List.GetItemAtIndex(list=transpose@L3, index=code_block_4)
code_block_5 = CodeBlock { 0; }
getItemAtIndex_3 = List.GetItemAtIndex(list=transpose@L3, index=code_block_5)
code_block_6 = CodeBlock { "Category"; }
indexOf_2 = IndexOf(getItemAtIndex_3@@L2, code_block_6)
list_getitematindex_category = List.GetItemAtIndex(list=getItemAtIndex_2@L2, index=indexOf_2@L1)
flatten_2 = Flatten(list_getitematindex_category)
code_block_7 = CodeBlock { "ChangeType"; }
indexOf_3 = IndexOf(getItemAtIndex_3@L2, code_block_7)
list_getitematindex_change_type = List.GetItemAtIndex(list=getItemAtIndex_2@L2, index=indexOf_3@L1)
flatten_3 = Flatten(list_getitematindex_change_type)
code_block_8 = CodeBlock { "ModelSummary"; }
indexOf_4 = IndexOf(getKeys, code_block_8)
getItemAtIndex_4 = List.GetItemAtIndex(list=toSublists, index=indexOf_4)
restOfItems_2 = List.RestOfItems(getItemAtIndex_4)
code_block_9 = CodeBlock { 1; }
flatten_4 = List.Flatten(list=restOfItems_2, amt=code_block_9)
transpose_2 = List.Transpose(flatten_4)
code_block_10 = CodeBlock { 0; }
getItemAtIndex_5 = List.GetItemAtIndex(list=transpose_2@L3, index=code_block_10)
flatten_5 = Flatten(getItemAtIndex_5)
code_block_11 = CodeBlock { 1; }
getItemAtIndex_6 = List.GetItemAtIndex(list=transpose_2@L3, index=code_block_11)
flatten_6 = Flatten(getItemAtIndex_6)

# group: Organize Data
groupByKey = List.GroupByKey(list=flatten_2@L2, keys=flatten_2@L2)
flatten_7 = Flatten(groupByKey.unique_keys)
count = Count(groupByKey.groups@L2)
sortByKey = List.SortByKey(list=flatten_7, keys=flatten_7)
containsItem = List.ContainsItem(list=flatten_5, item=sortByKey.sorted_list)
filterByBoolMask = List.FilterByBoolMask(list=sortByKey.sorted_list, mask=containsItem)
indexOf_5 = IndexOf(flatten_5, filterByBoolMask.in@L1)
getItemAtIndex_7 = List.GetItemAtIndex(list=flatten_5, index=indexOf_5)
sortByKey_2 = List.SortByKey(list=count, keys=flatten_7)
filterByBoolMask_2 = List.FilterByBoolMask(list=sortByKey_2.sorted_list, mask=containsItem)
getItemAtIndex_8 = List.GetItemAtIndex(list=flatten_6, index=indexOf_5)
code_block_12 = CodeBlock(y=filterByBoolMask_2.in, x=getItemAtIndex_8) { Math.Ceiling(y/x*100); }
maximumItem = List.MaximumItem(code_block_12)

# group: Create Donut Chart
watch_2 = Watch(flatten_7)
watch_3 = Watch(count)
data = Charts.DonutChart.Data(watch_2, watch_3)
code_block_13 = CodeBlock { 1; 2; }
address_2 = Charts.MiscNodes.Address(code_block_13.out0, code_block_13.out1)
boolean = BoolSelector(false)
style_2 = Charts.DonutChart.Style(arg2=address_2, arg5=boolean)
chart = Charts.DonutChart.Chart(data, style_2)

# group: Number of Change by Change Type
string_2 = StringInput("Number of Changes by Change Type")
code_block_14 = CodeBlock { 5; 1; }
address_3 = Charts.MiscNodes.Address(code_block_14.out0, code_block_14.out1)
style_3 = Text.Text.Style(arg1=address_3)
create_2 = Text.Text.Create(string_2, style_3)
groupByKey_2 = List.GroupByKey(list=flatten_2@L2, keys=flatten_3@L2)
watch_4 = Watch(groupByKey_2.unique_keys)
flatten_8 = Flatten(watch_4)
string_from_object = FromObject(flatten_8)
count_2 = Count(groupByKey_2.groups@L2)
data_2 = Charts.DonutChart.Data(string_from_object, count_2)
code_block_15 = CodeBlock { 5; 2; }
address_4 = Charts.MiscNodes.Address(code_block_15.out0, code_block_15.out1)
boolean_2 = BoolSelector(false)
style_4 = Charts.DonutChart.Style(arg2=address_4, arg5=boolean_2)
chart_2 = Charts.DonutChart.Chart(data_2, style_4)
sum = Math.Sum(count_2)
code_block_16 = CodeBlock(x=count_2, y=sum) { Math.Ceiling(x/y*100); }

count_3 = List.Count(getItemAtIndex_7)

# group: Generate Bar Chart
watch_5 = Watch()  # unwired: arg0
firstItem = List.FirstItem(watch_5@L2)
code_block_17 = CodeBlock(x=maximumItem) { 0; x+5; }
domain = Charts.MiscNodes.Domain(code_block_17.out0, code_block_17.out1)
data_3 = Charts.BarChart.Data(getItemAtIndex_7, code_block_12, domain)
code_block_18 = CodeBlock { 1; 8; }
address_5 = Charts.MiscNodes.Address(code_block_18.out0, code_block_18.out1)
code_block_19 = CodeBlock { 150; }
margins = Charts.MiscNodes.Margins(arg1=code_block_19)
code_block_20 = CodeBlock { 600; }
code_block_21 = CodeBlock { "Percent of Items Changed by Category"; }
code_block_22 = CodeBlock { 90; }
style_5 = Charts.BarChart.Style(arg2=address_5, arg3=margins, arg4=code_block_20, arg5=code_block_20, arg6=code_block_21, arg7=count_3, arg8=code_block_22)
chart_3 = Charts.BarChart.Chart(data_3, style_5)

# group: Add Text to Chart
string_3 = StringInput("Number of Changes by Level Shown by Category")
code_block_23 = CodeBlock { 10; 7; }
address_6 = Charts.MiscNodes.Address(code_block_23.out0, code_block_23.out1)
style_6 = Text.Text.Style(arg1=address_6)
create_3 = Text.Text.Create(string_3, style_6)

# group: Get All Levels from Project
code_block_24 = CodeBlock { "LevelNames"; }
indexOf_6 = IndexOf(getKeys, code_block_24)
getItemAtIndex_9 = List.GetItemAtIndex(list=toSublists, index=indexOf_6)
restOfItems_3 = List.RestOfItems(getItemAtIndex_9)
flatten_9 = Flatten(restOfItems_3)
code_block_25 = CodeBlock { "Level"; }
indexOf_7 = IndexOf(getItemAtIndex_3@L2, code_block_25)
list_getitematindex_level = List.GetItemAtIndex(list=getItemAtIndex_2@L2, index=indexOf_7@L1)
flatten_10 = Flatten(list_getitematindex_level)

# group: Create Parralel Coordinates Chart
code_block_26 = CodeBlock { "LEVELS"; }
code_block_27 = CodeBlock { "Level"; "Lvl"; }
replace = String.Replace(str=flatten_9, searchFor=code_block_27.out0, replaceWith=code_block_27.out1)
addItemToFront = List.AddItemToFront(item=code_block_26, list=replace)
code_block_28 = CodeBlock { ""; }
ne = flatten_10 != code_block_28
filterByBoolMask_3 = List.FilterByBoolMask(list=flatten_10, mask=ne)
filterByBoolMask_4 = List.FilterByBoolMask(list=flatten_2, mask=ne)
groupByKey_3 = List.GroupByKey(list=filterByBoolMask_3.in, keys=filterByBoolMask_4.in)
create_4 = List.Create()  # unwired: arg0
map = List.Map(list=groupByKey_3.unique_keys, f_x=create_4)
code_block_29 = CodeBlock { 0; }
count_4 = Count(flatten_9)
ofRepeatedItem = List.OfRepeatedItem(item=code_block_29, amount=count_4)
groupByKey_4 = List.GroupByKey(list=filterByBoolMask_4.in, keys=filterByBoolMask_4.in)
groupByKey_5 = List.GroupByKey(list=groupByKey_4.groups@L2, keys=groupByKey_3.groups@L2)
count_5 = Count(groupByKey_5.unique_keys)
ofRepeatedItem_2 = List.OfRepeatedItem(item=ofRepeatedItem, amount=count_5)
indexOf_8 = IndexOf(flatten_9, groupByKey_5.unique_keys@@L1)
count_6 = List.Count(groupByKey_5.groups@@L2)
sortByKey_3 = List.SortByKey(list=count_6@L2, keys=groupByKey_5.unique_keys@L2)
replaceItemAtIndex = List.ReplaceItemAtIndex(list=ofRepeatedItem_2@L2, index=indexOf_8@L2, item=sortByKey_3.sorted_list@L1)
transpose_3 = List.Transpose(replaceItemAtIndex@@L3)
sum_2 = Math.Sum(transpose_3@@L2, lacing=Longest)
addItemToFront_2 = List.AddItemToFront(item=map@L1, list=sum_2@L2)
data_4 = Charts.ParallelCoordinates.Data(addItemToFront, addItemToFront_2)
code_block_30 = CodeBlock { 8; 9; }
address_7 = Charts.MiscNodes.Address(code_block_30.out0, code_block_30.out1)
style_7 = Charts.ParallelCoordinates.Style(arg1=address_7)
chart_4 = Charts.ParallelCoordinates.Chart(data_4, style_7)
groupByKey_6 = List.GroupByKey(list=filterByBoolMask_3.in, keys=filterByBoolMask_3.in)

# group: Add Text to Chart
string_4 = StringInput("Number of Changes by Level Shown by Category")
code_block_31 = CodeBlock { 1; 7; }
address_8 = Charts.MiscNodes.Address(code_block_31.out0, code_block_31.out1)
style_8 = Text.Text.Style(arg1=address_8)
create_5 = Text.Text.Create(string_4, style_8)

# group: List of Change Types
uniqueItems = List.UniqueItems(flatten_3)
sort = List.Sort(uniqueItems)

# group: Create Stacked Bar Chart
code_block_32 = CodeBlock { "Change Type"; }
watch_6 = Watch(sort)
watch_7 = Watch(watch_6)
addItemToFront_3 = List.AddItemToFront(item=code_block_32, list=watch_7)
watch_8 = Watch(flatten_3)
code_block_33 = CodeBlock { ""; }
ne_2 = watch_8 != code_block_33
filterByBoolMask_5 = List.FilterByBoolMask(list=watch_8, mask=ne_2)
filterByBoolMask_6 = List.FilterByBoolMask(list=flatten_2, mask=ne_2)
groupByKey_7 = List.GroupByKey(list=filterByBoolMask_5.in, keys=filterByBoolMask_6.in)
create_6 = List.Create()  # unwired: arg0
map_2 = List.Map(list=groupByKey_7.unique_keys, f_x=create_6)
code_block_34 = CodeBlock { 0; }
count_7 = Count(watch_6)
ofRepeatedItem_3 = List.OfRepeatedItem(item=code_block_34, amount=count_7)
groupByKey_8 = List.GroupByKey(list=filterByBoolMask_6.in, keys=filterByBoolMask_6.in)
groupByKey_9 = List.GroupByKey(list=groupByKey_8.groups@L2, keys=groupByKey_7.groups@L2)
count_8 = Count(groupByKey_9.unique_keys)
ofRepeatedItem_4 = List.OfRepeatedItem(item=ofRepeatedItem_3, amount=count_8)
indexOf_9 = IndexOf(watch_6, groupByKey_9.unique_keys@@L1)
count_9 = List.Count(groupByKey_9.groups@@L2)
code_block_35 = CodeBlock { 8; 9; }
address_9 = Charts.MiscNodes.Address(code_block_35.out0, code_block_35.out1)
style_9 = Charts.StackedBarChart.Style(arg2=address_9)

# note: Clockwork
replaceItemAtIndex_2 = Custom[List.ReplaceItemAtIndex](seq=ofRepeatedItem_4@L2, index=indexOf_9@L2, replacement=count_9@L2)  # Replaces the item at a given index (or list of indices) of a list by another item

# group (continued): Create Stacked Bar Chart
addItemToFront_4 = List.AddItemToFront(item=map_2@L1, list=replaceItemAtIndex_2@L2)
restOfItems_4 = List.RestOfItems(addItemToFront_4@L2)
sum_3 = Math.Sum(restOfItems_4)
maximumItem_2 = List.MaximumItem(sum_3)
code_block_36 = CodeBlock(x=maximumItem_2) { x+5; }
domain_2 = Charts.MiscNodes.Domain(arg1=code_block_36)
data_5 = Charts.StackedBarChart.Data(addItemToFront_3, addItemToFront_4, domain_2)
chart_5 = Charts.StackedBarChart.Chart(data_5, style_9)

create_report = MandrillReportNode(create, chart, create_2, chart_2, chart_3, create_3, chart_4, create_5, chart_5)
report_window = MandrillWindowNodeModel(create_report)
watch_9 = Watch(groupByKey_9.unique_keys)
